# Grasshopper definition initialise_toolkit.gh (Grasshopper 1.0.8)

py3 = Python3Script()  # -> out, Result, Errors
# ---------- py3: Python ----------
Result = None
Errors = []

import os
import sys
import traceback

try:
    repo = os.getenv("GH_PARAMETRIC_TOOLKIT")
    if repo and repo not in sys.path:
        sys.path.insert(0, repo)

    from shared.loader import ensure_repo_on_syspath, run_tool
    ensure_repo_on_syspath()

    def main():
        from bootstrap.src.initialise import initialise
        return initialise()

    Result, Errors = run_tool(main)

except Exception:
    Errors = [
        "SETUP: The toolkit could not start.",
        "Check installation, environment setup, and that Rhino was launched from the correct terminal.",
        traceback.format_exc()
    ]
# ---------- end py3 ----------
panel = Panel(py3.Result)
panel_2 = Panel(py3.Errors)
