# Grasshopper definition adaptive_fenestration.gh (Grasshopper 1.0.8)

panel = Panel("""694.751276
659.084691
649.679492
676.570165
746.402634
856.791145
944.921132
959.165534
907.903683
855.662633
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""")
panel_2 = Panel("""P-F01-01-01
P-F01-02-01
P-F01-03-01
P-F01-04-01
P-F01-05-01
P-F01-06-01
P-F01-07-01
P-F01-08-01
P-F01-09-01
P-F01-10-01
P-F01-11-01
P-F01-12-01
P-F01-13-01
P-F01-14-01
P-F01-15-01
P-F01-16-01
P-F01-17-01
P-F01-18-01
P-F01-19-01
P-F01-20-01
P-F01-21-01
P-F01-22-01
P-F01-23-01
P-F01-24-01
P-F02-01-01
P-F02-02-01
P-F02-03-01
P-F02-04-01
P-F02-05-01
P-F02-06-01
P-F02-07-01
P-F02-08-01
P-F02-09-01
P-F02-10-01
P-F02-11-01
P-F02-12-01
P-F02-13-01
P-F02-14-01
P-F02-15-01
P-F02-16-01
P-F02-17-01
P-F02-18-01
P-F02-19-01
P-F02-20-01
P-F02-21-01
P-F02-22-01
P-F02-23-01
P-F02-24-01
P-F03-01-01
P-F03-02-01
P-F03-03-01
P-F03-04-01
P-F03-05-01
P-F03-06-01
P-F03-07-01
P-F03-08-01
P-F03-09-01
P-F03-10-01
P-F03-11-01
P-F03-12-01
P-F03-13-01
P-F03-14-01
P-F03-15-01
P-F03-16-01
P-F03-17-01
P-F03-18-01
P-F03-19-01
P-F03-20-01
P-F03-21-01
P-F03-22-01
P-F03-23-01
P-F03-24-01
P-F04-01-01
P-F04-02-01
P-F04-03-01
P-F04-04-01
P-F04-05-01
P-F04-06-01
P-F04-07-01
P-F04-08-01
P-F04-09-01
P-F04-10-01
P-F04-11-01
P-F04-12-01
P-F04-13-01
P-F04-14-01
P-F04-15-01
P-F04-16-01
P-F04-17-01
P-F04-18-01
P-F04-19-01
P-F04-20-01
P-F04-21-01
P-F04-22-01
P-F04-23-01
P-F04-24-01
P-F05-01-01
P-F05-02-01
P-F05-03-01
P-F05-04-01
P-F05-05-01
P-F05-06-01
P-F05-07-01
P-F05-08-01
P-F05-09-01
P-F05-10-01
P-F05-11-01
P-F05-12-01
P-F05-13-01
P-F05-14-01
P-F05-15-01
P-F05-16-01
P-F05-17-01
P-F05-18-01
P-F05-19-01
P-F05-20-01
P-F05-21-01
P-F05-22-01
P-F05-23-01
P-F05-24-01
P-F06-01-01
P-F06-02-01
P-F06-03-01
P-F06-04-01
P-F06-05-01
P-F06-06-01
P-F06-07-01
P-F06-08-01
P-F06-09-01
P-F06-10-01
P-F06-11-01
P-F06-12-01
P-F06-13-01
P-F06-14-01
P-F06-15-01
P-F06-16-01
P-F06-17-01
P-F06-18-01
P-F06-19-01
P-F06-20-01
P-F06-21-01
P-F06-22-01
P-F06-23-01
P-F06-24-01""")
srf = Surface([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])
crv = Curve(<curve referenced from the Rhino model>)
offset = OffsetSurface(Surface=srf, Distance=Slider(50, range=0..100), Retrim=Toggle(True))
adaptive_fenestration = Python3Script(
    Debug=Toggle(True),
    IDs=panel_2,
    DataValues=panel,
    OpeningShape=crv,
    MinOpening=Slider(0.1, range=0..1),
    MaxOpening=Slider(0.5, range=0..1),
    NumCategories=Slider(11, range=0..100),
    Invert=Toggle(True))  # -> out, FenestratedPanels, FenestrationData, Categories, ScaleFactors, Errors; inputs Debug: Boolean, Panels: list of Surface, IDs: list, DataValues: list of Double, OpeningShape: Curve, MinOpening: Double, MaxOpening: Double, NumCategories: Int32
#   port MinOpening: Opening size range 0-1
#   port MaxOpening: Opening size range 0-1
# ---------- adaptive_fenestration: Python ----------
"""
Adaptive Fenestration Component

Inputs:
  Panels (list): Panel surfaces
  IDs (list): Panel identifiers
  DataValues (list): Scalar data (irradiance, temperature, view analysis, etc.)
  OpeningShape (Curve): Custom opening shape (closed planar curve)
  MinOpening (float): Minimum opening size (0-1, default: 0.0 = solid)
  MaxOpening (float): Maximum opening size (0-1, default: 0.5 = 50%)
  NumCategories (int): Number of discrete size categories (default: 11)
  Invert (bool): True = high data → small opening, False = high data → large opening
  Debug (bool): Show detailed errors (optional)

Outputs:
  FenestratedPanels (list): Panels with openings
  FenestrationData (list): Opening information (scale, area, %, category)
  Categories (list): Data categories (0 to NumCategories-1)
  ScaleFactors (list): Opening scale factors for each panel
  Errors (list): Error messages if any
"""

FenestratedPanels = None
FenestrationData = None
Categories = None
ScaleFactors = None
Errors = []

import os
import sys
import traceback

try:
    repo = os.getenv("GH_PARAMETRIC_TOOLKIT")
    if repo and repo not in sys.path:
        sys.path.insert(0, repo)

    from shared.loader import run_tool

    def main():
        from tools.src.adaptive_fenestration import adaptive_fenestration
        
        panels_list = list(Panels)
        ids_list = list(IDs)
        data_list = list(DataValues)
        opening_shape = OpeningShape
        min_open = float(MinOpening) if MinOpening else 0.0
        max_open = float(MaxOpening) if MaxOpening else 0.5
        num_cats = int(NumCategories) if NumCategories else 11
        invert_logic = bool(Invert) if Invert is not None else True
        
        fenestrated, data, cats, scales = adaptive_fenestration(
            panels_list, 
            ids_list, 
            data_list, 
            opening_shape,
            min_open,
            max_open,
            num_cats,
            invert_logic
        )
        
        return fenestrated, data, cats, scales

    result, Errors = run_tool(main, debug=bool(Debug))

    if result is not None:
        FenestratedPanels, FenestrationData, Categories, ScaleFactors = result

except Exception:
    Errors = [
        "SETUP ERROR: Toolkit could not start. Follow Local Setup steps and relaunch Rhino from Terminal / Command Prompt.\n\n"
    ]
    if "Debug" in globals() and bool(Debug):
        Errors.append(traceback.format_exc())
# ---------- end adaptive_fenestration ----------
loft = Loft(Options={Adjust=False, Closed=True, LoftEnds=0, LoftSimp=0, LoftType=0, Rebuild=10, Refit=0.01})
panel_3 = Panel(adaptive_fenestration.FenestratedPanels)
panel_4 = Panel(adaptive_fenestration.FenestrationData)
panel_5 = Panel(adaptive_fenestration.Categories)
panel_6 = Panel(adaptive_fenestration.ScaleFactors)
panel_7 = Panel(adaptive_fenestration.Errors)
