# Grasshopper definition facade_panelizer.gh (Grasshopper 1.0.8)

U = Slider(29, range=1..50)
V = Slider(7, range=1..50)
srf = Surface(<surface referenced from the Rhino model>)
facade_panelizer = Python3Script(Debug=Toggle(False), Srf=srf, Prefix="P", U=U, V=V)  # -> out, Panels, IDs, Dimensions, MaxPanelDim, Errors; inputs Srf: list of Surface
# ---------- facade_panelizer: Python ----------
"""
Facade Panelizer Component

Inputs:
  Srf (Surface/List): Surface(s), BrepFace(s), or Brep(s) to panelize
  U (int): Number of divisions in U direction (horizontal)
  V (int): Number of divisions in V direction (vertical)
  Prefix (str): Panel ID prefix (optional, default: "P")
  Debug (bool): Show detailed errors (optional)

Outputs:
  Panels (list): Panel surfaces (NURBS patches)
  IDs (list): Panel identifiers (e.g., "P-01-01")
  Dimensions (list): Panel dimensions (width, height) tuples
  MaxPanelDim (float): Maximum dimension (width or height) across all panels
  Errors (list): Error messages if any
"""

Panels = None
IDs = None
Dimensions = None
MaxPanelDim = None
Errors = []

import os
import sys
import traceback

try:
    repo = os.getenv("GH_PARAMETRIC_TOOLKIT")
    if repo and repo not in sys.path:
        sys.path.insert(0, repo)

    from shared.loader import run_tool

    def main():
        from tools.src.facade_panelizer import panelize_surface
        
        surfaces = list(Srf) if hasattr(Srf, '__iter__') else [Srf]
        u = int(U)
        v = int(V)
        prefix = (Prefix or "P").strip()
        
        all_panels = []
        all_ids = []
        all_dimensions = []
        
        for i, srf in enumerate(surfaces):
            surface_prefix = f"{prefix}-S{i+1:02d}" if len(surfaces) > 1 else prefix
            panels, ids, dims = panelize_surface(srf, u, v, surface_prefix)
            all_panels.extend(panels)
            all_ids.extend(ids)
            all_dimensions.extend(dims)
        
        # Calculate maximum dimension (width or height)
        max_panel_dim = max(max(d[0], d[1]) for d in all_dimensions)
        
        return all_panels, all_ids, all_dimensions, max_panel_dim

    result, Errors = run_tool(main, debug=bool(Debug))

    if result is not None:
        Panels, IDs, Dimensions, MaxPanelDim = result

except Exception:
    Errors = [
        "SETUP ERROR: Toolkit could not start. Follow Local Setup steps and relaunch Rhino from Terminal / Command Prompt.\n\n"
    ]
    if "Debug" in globals() and bool(Debug):
        Errors.append(traceback.format_exc())
# ---------- end facade_panelizer ----------
panel = Panel(facade_panelizer.Panels)
panel_2 = Panel(facade_panelizer.IDs)
panel_3 = Panel(facade_panelizer.Dimensions)
panel_4 = Panel(facade_panelizer.MaxPanelDim)
panel_5 = Panel(facade_panelizer.Errors)
